# Grasshopper definition test-runner.gh (Grasshopper 1.0.8)
# plug-ins: Assertive Possum

rhino_compute_url = Panel("http://localhost:5000")
path = FilePath("C:\Users\spigach\GitHub\Swiftlet\AssertivePossumTests\tests\")
run = TestRunner(Source=path, Server=rhino_compute_url, Run=Toggle(True))  # -> Reports, Summary, AllPassed
view = ReportViewer(Report=run.Reports)  # -> Passed, Failed, Errors
passed = Panel(view.Passed)
failed = Panel(view.Failed)
error = Panel(view.Errors)
lng = ListLength(List=passed)
lng_2 = ListLength(List=failed)
lng_3 = ListLength(List=error)
panel = Panel(lng)
panel_2 = Panel(lng_2)
panel_3 = Panel(lng_3)
